# Dynamo graph NP_DP_Bauteil_Anpassen_Höhe-nachWandtyp.dyn "NP_DP_Bauteil_Höhe_nachWandtyp" (Dynamo 2.19.3.6394)

categories = Categories("OST_Walls")  # graph input
all_elements_of_category = ElementsOfCategory(Category=categories)
elementType = Element.ElementType(element=all_elements_of_category)
quellparameter_string = StringInput("NP_Material")  # graph input
getParameterValueByName = Element.GetParameterValueByName(element=elementType, parameterName=quellparameter_string)
filterwert_string = StringInput("STB")  # graph input
boolean = BoolSelector(true)
contains = String.Contains(string=getParameterValueByName, searchFor=filterwert_string, ignoreCase=boolean)
filterByBoolMask = List.FilterByBoolMask(list=all_elements_of_category, mask=contains)
zielparameter_string = StringInput("Versatz oben")  # graph input
zielwert_number = DoubleInput(-0.04)
setParameterByName = Element.SetParameterByName(element=filterByBoolMask.in, parameterName=zielparameter_string, value=zielwert_number)
