# Dynamo graph NP_DP_Bauteil_Auswaehlen_nachBasisbauteil.dyn (Dynamo 2.19.3.6394)
# packages: Crumple 2024.4.3

categories = Categories("OST_Walls")  # graph input
all_elements_of_category = ElementsOfCategory(Category=categories)
elementType = Element.ElementType(element=all_elements_of_category)
name = ElementType.Name(elementType=elementType)
bauteil_typname_string = StringInput("NP_I_W_STB_SW_OB_SB2-1s_C30/37_F90_30")  # graph input
contains = String.Contains(string=name, searchFor=bauteil_typname_string)
filterByBoolMask = List.FilterByBoolMask(list=all_elements_of_category, mask=contains)
boolean = BoolSelector(false)
getHostedElements = Element.GetHostedElements(element=filterByBoolMask.in, includeOpenings=boolean, includeHostedElementsOfJoinedHosts=boolean, includeEmbeddedWalls=boolean, includeSharedEmbeddedInserts=boolean)
elements_select = Custom[© Elements.Select](elements=getHostedElements)  # package Crumple; Given a list of elements, select them in the Revit document.
