# Dynamo graph NP_DP_Bauteil_Auswaehlen_nachParameterWert.dyn "NP_DP_Parameter_Filter_Wert" (Dynamo 2.19.3.6394)
# packages: Crumple 2024.4.3

categories = Categories("OST_Doors")  # graph input
all_elements_of_category = ElementsOfCategory(Category=categories)
quellparameter_string = StringInput("NP_Flucht_Tür")  # graph input
getParameterValueByName = Element.GetParameterValueByName(element=all_elements_of_category, parameterName=quellparameter_string)
string_from_object = FromObject(object=getParameterValueByName)
filterwert_string = StringInput("-")  # graph input
contains = String.Contains(string=string_from_object, searchFor=filterwert_string)
filterByBoolMask = List.FilterByBoolMask(list=all_elements_of_category, mask=contains)
elements_select = Custom[© Elements.Select](elements=filterByBoolMask.in)  # package Crumple; Given a list of elements, select them in the Revit document.
