# Dynamo graph NP_DP_Bauteil_Isolieren_nachTypname.dyn (Dynamo 2.19.3.6394)
# packages: archi-lab.net 2025.300.1225, Crumple 2024.4.3

categories = Categories("OST_Doors")  # graph input
all_elements_of_category = ElementsOfCategory(Category=categories)
type = archilab.Revit.Elements.Elements.Type(element=all_elements_of_category)
familyName = ElementType.FamilyName(elementType=type)
string_from_object = FromObject(object=familyName)
typ_filterwert_string = StringInput("Holztür")  # graph input
contains = String.Contains(string=string_from_object, searchFor=typ_filterwert_string)
filterByBoolMask = List.FilterByBoolMask(list=all_elements_of_category, mask=contains)
revit_currentview = Custom[© Revit.CurrentView]()  # package Crumple; Given the current document, return the active view.
isolate_in_view = Custom[Isolate in View](element=filterByBoolMask.in, view=revit_currentview)  # package archi-lab.net; This node will take input of elements and a view to isolate selected elements in a view.
