# Dynamo graph NP_DP_Bauteil_Isolieren_nachWarnung.dyn (Dynamo 2.19.3.6394)
# packages: Clockwork for Dynamo 2.x 2.3.0, Crumple 2024.4.3, Bang! 2021.4.3

currentview = Custom[© CurrentView]()  # package Crumple; Given the current document, return the active view.
boolean = BoolSelector(true)
getWarnings = Bang.Revit.Elements.WarningTools.GetWarnings(toggle=boolean)
warnungstext_string = StringInput(" Überprüfen Sie die Fließrichtung in allen Geräten im System.")  # graph input
boolean_2 = BoolSelector(true)
contains = String.Contains(string=getWarnings.Warning_Text, searchFor=warnungstext_string, ignoreCase=boolean_2)
filterByBoolMask = List.FilterByBoolMask(list=getWarnings.Failing_Elements, mask=contains)
flatten = List.Flatten(list=filterByBoolMask.in)
id = Element.Id(element=flatten)
element_by_id = ElementById(Id=id)
temporarilyIsolateElement = Custom[View.TemporarilyIsolateElement](view=currentview, element=element_by_id)  # package Clockwork for Dynamo 2.x; Temporarily isolates elements in the given view
