# Dynamo graph NP_DP_Bauteil_Isolieren_nachZweiParameterWerte.dyn (Dynamo 2.19.3.6394)
# packages: Rhythm 2025.10.3, archi-lab.net 2025.300.1225, Crumple 2024.4.3

categories = Categories("OST_Doors")  # graph input
all_elements_of_category = ElementsOfCategory(Category=categories)
string = StringInput("NP_ZuKo_Offline,NP_ZuKo_Online")  # graph input
string_2 = StringInput(",")
split = String.Split(string=string, separator0=string_2)
ʳʰʸᵗʰᵐ_elements = Rhythm.Revit.Elements.Elements.GetParameterValueByNameTypeOrInstance(element=all_elements_of_category, parameterName=split@L1)
code_block = CodeBlock(input=ʳʰʸᵗʰᵐ_elements) { input == "Ja"; }
code_block_2 = CodeBlock(input=code_block) { input[0]; input[1]; }
code_block_3 = CodeBlock(input=code_block_2.out0) { input == true; }
filterByBoolMask = List.FilterByBoolMask(list=all_elements_of_category, mask=code_block_3)
id = Element.Id(element=filterByBoolMask.in)
code_block_4 = CodeBlock(input=code_block_2.out1) { input == true; }
filterByBoolMask_2 = List.FilterByBoolMask(list=all_elements_of_category, mask=code_block_4)
id_2 = Element.Id(element=filterByBoolMask_2.in)
python_script = Python(IN[0]=id, IN[1]=id_2)  # CPython3
# ---------- python_script.python (10 lines) ----------
A=IN[0]
B=IN[1]

S=[]
for a in A:
	if a in B:
		S.append(True)
	else:
		S.append(False)
OUT=S
# ----------------------------------------
filterByBoolMask_3 = List.FilterByBoolMask(list=filterByBoolMask.in, mask=python_script)
revit_currentview = Custom[© Revit.CurrentView]()  # package Crumple; Given the current document, return the active view.
isolate_in_view = Custom[Isolate in View](element=filterByBoolMask_3.in, view=revit_currentview)  # package archi-lab.net; This node will take input of elements and a view to isolate selected elements in a view.
