# Dynamo graph NP_DP_Bauteil_Nummerieren_nachSpline.dyn (Dynamo 2.19.3.6394)
# packages: archi-lab.net 2025.300.1225, Crumple 2024.4.3

categories = Categories("OST_Doors")  # graph input
current_document = Custom[Current Document]()  # package archi-lab.net; Retrieves Current Document
revit_currentview = Custom[© Revit.CurrentView](refresh=current_document)  # package Crumple; Given the current document, return the active view.
all_elements_of_category_in_view = ElementsOfCategoryInView(Category=categories, View=revit_currentview)
watch = Watch(all_elements_of_category_in_view)
spline_auswählen_select_model = DSModelElementSelection()  # "Spline Auswählen - Select Model Element"; 1 picked in the model; graph input
geometry = Element.Geometry(element=spline_auswählen_select_model)
XY = Plane.XY()
pullOntoPlane = Curve.PullOntoPlane(curve=geometry, plane=XY)
current_document_2 = Custom[Current Document]()
revit_currentview_2 = Custom[© Revit.CurrentView](refresh=current_document_2)
python_script = Python(IN[0]=watch, IN[1]=revit_currentview_2)  # CPython3
# ---------- python_script.python (61 lines) ----------
import clr
# Revit & Dynamo setup
clr.AddReference("RevitAPI")
clr.AddReference("RevitServices")
clr.AddReference("RevitNodes")
import Revit
clr.ImportExtensions(Revit.GeometryConversion)
from RevitServices.Persistence import DocumentManager
from Autodesk.Revit.DB import *

import Autodesk.DesignScript.Geometry as DSG

# Inputs
doors = UnwrapElement(IN[0])  # list of doors
view = UnwrapElement(IN[1])   # plan view
doc = DocumentManager.Instance.CurrentDBDocument

rectangles = []

for door in doors:
    try:
        bbox = door.get_BoundingBox(view)
        if not bbox:
            continue

        # Door center point
        center = XYZ(
            (bbox.Min.X + bbox.Max.X) / 2.0,
            (bbox.Min.Y + bbox.Max.Y) / 2.0,
            (bbox.Min.Z + bbox.Max.Z) / 2.0
        )

        # Door orientation vectors
        facing = door.FacingOrientation.Normalize()
        hand = door.HandOrientation.Normalize()

        # Half extents (use bbox dimensions)
        half_width = abs((bbox.Max.X - bbox.Min.X) / 2.0)
        half_depth = abs((bbox.Max.Y - bbox.Min.Y) / 2.0)

        # Define corner points in door local coordinates
        def local_point(center, hand, facing, hw, hd, h_sign, f_sign):
            """Helper to calculate point from center using signed directions"""
            return center.Add(hand.Multiply(hw * h_sign)).Add(facing.Multiply(hd * f_sign))

        p1 = local_point(center, hand, facing, half_width, half_depth, -1, -1)
        p2 = local_point(center, hand, facing, half_width, half_depth,  1, -1)
        p3 = local_point(center, hand, facing, half_width, half_depth,  1,  1)
        p4 = local_point(center, hand, facing, half_width, half_depth, -1,  1)

        # Convert to Dynamo points
        pts = [p1.ToPoint(), p2.ToPoint(), p3.ToPoint(), p4.ToPoint(), p1.ToPoint()]

        # Create closed PolyCurve
        poly = DSG.PolyCurve.ByPoints(pts)
        rectangles.append(poly)

    except Exception as e:
        rectangles.append(str(e))

OUT = rectangles
# ----------------------------------------
pullOntoPlane_2 = Curve.PullOntoPlane(curve=python_script, plane=XY)
intersect = Geometry.Intersect(geometry=pullOntoPlane, other=pullOntoPlane_2, lacing=Longest)
isEmpty = List.IsEmpty(list=intersect, lacing=Longest)
filterByBoolMask = List.FilterByBoolMask(list=watch, mask=isEmpty)
filterByBoolMask_2 = List.FilterByBoolMask(list=intersect, mask=isEmpty)
integer_slider = IntegerSlider(0, range=0..100 step 1)
getItemAtIndex = List.GetItemAtIndex(list=filterByBoolMask_2.out@L2, index=integer_slider)
parameterAtPoint = Curve.ParameterAtPoint(curve=pullOntoPlane, point=getItemAtIndex, lacing=Longest)
sortByKey = List.SortByKey(list=filterByBoolMask.out, keys=parameterAtPoint)
zielparameter_string = StringInput("NP_Laufende_Türnummer")  # graph input
number_slider = DoubleSlider(1, range=0..100 step 0.1)
count = List.Count(list=sortByKey.sortedList)
number_slider_2 = DoubleSlider(1, range=0..100 step 0.1)
sequence = Sequence(start=number_slider, amount=count, step=number_slider_2)
string_from_object = FromObject(object=sequence)
string = StringInput(",")
split = String.Split(string=string_from_object, separator0=string)
integer_slider_2 = IntegerSlider(0, range=0..100 step 1)
getItemAtIndex_2 = List.GetItemAtIndex(list=split, index=integer_slider_2, lacing=Longest)
setParameterByName = Element.SetParameterByName(element=sortByKey.sortedList, parameterName=zielparameter_string, value=getItemAtIndex_2)
