# Dynamo graph NP_DP_Bauteil_WertSetzen_nachBasisbauteil.dyn (Dynamo 2.19.3.6394)

categories = Categories("OST_Walls")  # graph input
all_elements_of_category = ElementsOfCategory(Category=categories)
elementType = Element.ElementType(element=all_elements_of_category)
name = ElementType.Name(elementType=elementType)
bauteil_typname_string = StringInput("NP_I_W_STB_SW_OB_SB2-1s_C30/37_F90_30")  # graph input
contains = String.Contains(string=name, searchFor=bauteil_typname_string)
filterByBoolMask = List.FilterByBoolMask(list=all_elements_of_category, mask=contains)
boolean = BoolSelector(false)
getHostedElements = Element.GetHostedElements(element=filterByBoolMask.in, includeOpenings=boolean, includeHostedElementsOfJoinedHosts=boolean, includeEmbeddedWalls=boolean, includeSharedEmbeddedInserts=boolean)
zielparameter_string = StringInput("NP_Einbruchhemmung")  # graph input
zielwert_string = StringInput("RC3")  # graph input
ʳʰʸᵗʰᵐ_elements = Rhythm.Revit.Elements.Elements.SetParameterByNameTypeOrInstance(element=getHostedElements, parameterName=zielparameter_string, value=zielwert_string)
