# Dynamo graph NP_DP_Bearbeitungsbereich_Analyse-BearbeitungsbereichTypen-nachKategorie.dyn (Dynamo 2.19.3.6394)
# packages: Clockwork for Dynamo 2.x 2.3.0

categories = Categories("OST_Doors")  # graph input
all_elements_of_category = ElementsOfCategory(Category=categories)
workset = Custom[Element.Workset](element=all_elements_of_category)  # package Clockwork for Dynamo 2.x; Retrieves the workset of a given element
kind = Custom[Workset.Kind](workset=workset)  # package Clockwork for Dynamo 2.x; Retrieves the kind of a given workset
uniqueItems = List.UniqueItems(list=kind)
