# Dynamo graph NP_DP_Bearbeitungsbereich_Analyse_SichtbarkeitnachAnsichttyp-Bearbeitungsbereich.dyn (Dynamo 2.19.3.6394)
# packages: Genius Loci 2024.5.29, Rhythm 2025.10.3, Clockwork for Dynamo 2.x 2.3.0

categories = Categories("OST_Views")
all_elements_of_category = ElementsOfCategory(Category=categories)
type = Custom[View.Type](view=all_elements_of_category)  # package Clockwork for Dynamo 2.x; Returns the type of a given view
string_from_object = FromObject(object=type)
ansichttyp_string = StringInput("FloorPlan")  # graph input
eq = string_from_object == ansichttyp_string
filterByBoolMask = List.FilterByBoolMask(list=all_elements_of_category, mask=eq)
bearbeitungsbereich_string = StringInput("03 Türen")  # graph input
workset_byname = Custom[Workset ByName](WorksetName=bearbeitungsbereich_string)  # package Genius Loci; Retrieves the workset by the given name.
ʳʰʸᵗʰᵐ_view_getworksetvisibility = Rhythm.Revit.Views.View.GetWorksetVisibility(view=filterByBoolMask.in, worksetId=workset_byname.Id)
code_block = CodeBlock(input=ʳʰʸᵗʰᵐ_view_getworksetvisibility)
# ---------- code_block.designscript (2 lines) ----------
input == "Use Global Setting (Visible)" ? "True":
input == "Show" ? "True": "False";
# ----------------------------------------
watch = Watch(code_block)
flatten = List.Flatten(list=watch)  # graph output
