# Dynamo graph NP_DP_Bearbeitungsbereich_ElementUebertragen_nachKategorie.dyn (Dynamo 2.19.3.6394)
# packages: Genius Loci 2024.5.29, Crumple 2024.4.3

categories = Categories("OST_Doors")  # graph input
all_elements_of_category = ElementsOfCategory(Category=categories)
element_workset = Custom[Element Workset](element=all_elements_of_category)  # package Genius Loci; Returns the workset of the given element.
aktueller_bearbeitungsbereich = StringInput("03 Türen")  # "Aktueller Bearbeitungsbereich - String"; graph input
eq = element_workset.Workset_Name == aktueller_bearbeitungsbereich
filterByBoolMask = List.FilterByBoolMask(list=all_elements_of_category, mask=eq)
ziel_bearbeitungsbereich_string = StringInput("Ausbau")  # graph input
workset_byname = Custom[Workset ByName](WorksetName=ziel_bearbeitungsbereich_string)  # package Genius Loci; Retrieves the workset by the given name.
elements_setworkset = Custom[© Elements.SetWorkset](elements=filterByBoolMask.in, workset=workset_byname.Workset)  # frozen; package Crumple; Given a workset and a list of elements, attempt to set those elements' worksets to it.
