# Dynamo graph NP_DP_Bearbeitungsbereich_Filter_ElementnachParameterWert-KategorieZuweisen.dyn (Dynamo 2.19.3.6394)
# packages: Genius Loci 2024.5.29, Crumple 2024.4.3, Rhythm 2025.10.3

categories = Categories("OST_Doors")  # graph input
all_elements_of_category = ElementsOfCategory(Category=categories)
quell_parameter_string = StringInput("NP_FilterParameterName")  # graph input
ʳʰʸᵗʰᵐ_elements = Rhythm.Revit.Elements.Elements.GetParameterValueByNameTypeOrInstance(element=all_elements_of_category, parameterName=quell_parameter_string)
string_from_object = FromObject(object=ʳʰʸᵗʰᵐ_elements)
parameter_wert_string = StringInput("Filter_Value")  # graph input
eq = string_from_object == parameter_wert_string
filterByBoolMask = List.FilterByBoolMask(list=ʳʰʸᵗʰᵐ_elements, mask=eq)
ziel_bearbeitungsbereich_string = StringInput("03 Türen")  # graph input
workset_byname = Custom[Workset ByName](WorksetName=ziel_bearbeitungsbereich_string)  # package Genius Loci; Retrieves the workset by the given name.
elements_setworkset = Custom[© Elements.SetWorkset](elements=filterByBoolMask.in, workset=workset_byname.Workset)  # package Crumple; Given a workset and a list of elements, attempt to set those elements' worksets to it.
