# Dynamo graph NP_DP_Bearbeitungsbereich_Isolieren_AktuellAnsicht-nachKategorie.dyn (Dynamo 2.19.3.6394)
# packages: Crumple 2024.4.3, Genius Loci 2024.5.29

revit_currentview = Custom[© Revit.CurrentView]()  # package Crumple; Given the current document, return the active view.
bearebitungsbereich_string = StringInput("03 Türen")  # graph input
workset_byname = Custom[Workset ByName](WorksetName=bearebitungsbereich_string)  # package Genius Loci; Retrieves the workset by the given name.
worksets_isolateinview = Custom[© Worksets.IsolateInView](views=revit_currentview, worksets=workset_byname.Workset)  # package Crumple; Given a list of views and a list of worksets or workset names, attempts to isolate them all in those views.
