# Dynamo graph NP_DP_Bearbeitungsbereich_Isolieren_AlleAnsichten-nachKategorie.dyn (Dynamo 2.19.3.6394)
# packages: Crumple 2024.4.3, Genius Loci 2024.5.29, archi-lab.net 2025.300.1225

view_types = Custom[View Types]()  # package Genius Loci; Enumerates the available view types.
code_block = CodeBlock(input=view_types)
# ---------- code_block.designscript (27 lines) ----------
input == "AreaPlan" ? "Flächenplan" :
input == "CeilingPlan" ? "Deckenplan" :
input == "ColumnSchedule" ? "Säulenliste" :
input == "CostReport" ? "Kostenbericht" :
input == "Detail" ? "Detailansicht" :
input == "DraftingView" ? "Entwurfsansicht" :
input == "DrawingSheet" ? "Zeichnungsblatt" :
input == "Elevation" ? "Ansicht" :
input == "EngineeringPlan" ? "Tragwerksplan" :
input == "FloorPlan" ? "Grundriss" :
input == "Internal" ? "Intern" :
input == "Legend" ? "Legende" :
input == "LoadsReport" ? "Lastenbericht" :
input == "PanelSchedule" ? "Schalttafelliste" :
input == "PresureLossReport" ? "Druckverlustbericht" :
input == "ProjectBrowser" ? "Projektbrowser" :
input == "Rendering" ? "Rendering" :
input == "Report" ? "Bericht" :
input == "Schedule" ? "Bauteilliste" :
input == "Section" ? "Schnitt" :
input == "SystemBrowser" ? "Systembrowser" :
input == "SystemsAnalysisReport" ? "Systemanalysebericht" :
input == "ThreeD" ? "3D-Ansicht" :
input == "Undefined" ? "Nicht definiert" :
input == "View Template" ? "Ansichtsvorlage" :
input == "Walkthrough" ? "Kamerafahrt" :
input;
# ----------------------------------------
ansichttype_string = StringInput("Grundriss")  # graph input
eq = code_block == ansichttype_string
filterByBoolMask = List.FilterByBoolMask(list=view_types, mask=eq)
getByType = archilab.Revit.Views.Views.GetByType(viewType=filterByBoolMask.in)
string = StringInput("03 Türen")
workset_byname = Custom[Workset ByName](WorksetName=string)  # package Genius Loci; Retrieves the workset by the given name.
worksets_isolateinview = Custom[© Worksets.IsolateInView](views=getByType@L2, worksets=workset_byname.Workset)  # package Crumple; Given a list of views and a list of worksets or workset names, attempts to isolate them all in those views.
