# Dynamo graph NP_DP_Bearbeitungsbereich_Zuweisen_Element-Kategorie.dyn (Dynamo 2.19.3.6394)
# packages: Genius Loci 2024.5.29, Crumple 2024.4.3

categories = Categories("OST_Doors")  # graph input
all_elements_of_category = ElementsOfCategory(Category=categories)
ziel_bearbeitungsbereich_string = StringInput("03 Türen")  # graph input
workset_byname = Custom[Workset ByName](WorksetName=ziel_bearbeitungsbereich_string)  # package Genius Loci; Retrieves the workset by the given name.
elements_setworkset = Custom[© Elements.SetWorkset](elements=all_elements_of_category, workset=workset_byname.Workset)  # package Crumple; Given a workset and a list of elements, attempt to set those elements' worksets to it.
