# Dynamo graph NP_DP_Entwurfsoptionen_Löschen_nachKategorie.dyn (Dynamo 2.19.3.6394)
# packages: archi-lab.net 2021.25.18, Genius Loci 2020.10.15

get_design_options = Custom[Get Design Options]()  # package archi-lab.net; Queries all of the design options currently in the project.
categories = Categories("OST_Rooms")  # graph input
selectByCategoryAndDesignOption = Custom[SelectByCategoryAndDesignOption](designOption=get_design_options.designOptions, category=categories)  # package Genius Loci; Select all elements by Design Option and category in the given document. Inspired by an archilab node.
delete = archilab.Revit.Elements.Elements.Delete(element=selectByCategoryAndDesignOption)
