# Dynamo graph NP_DP_Fläche_Rechnen_Aussparungen-Wände(Alle).dyn (Dynamo 2.19.3.6394)
# packages: Rhythm 2025.10.3, archi-lab.net 2025.300.1225

categories = Categories("OST_Walls")
all_elements_of_category = ElementsOfCategory(Category=categories)
boolean = BoolSelector(true)
boolean_2 = BoolSelector(false)
getHostedElements = Element.GetHostedElements(element=all_elements_of_category, includeOpenings=boolean, includeHostedElementsOfJoinedHosts=boolean_2, includeEmbeddedWalls=boolean_2, includeSharedEmbeddedInserts=boolean_2)
flatten = List.Flatten(list=getHostedElements)
code_block = CodeBlock { ["Höhe","Breite"]; }
ʳʰʸᵗʰᵐ_elements = Rhythm.Revit.Elements.Elements.GetParameterValueByNameTypeOrInstance(element=flatten@L1, parameterName=code_block)
firstItem = List.FirstItem(list=ʳʰʸᵗʰᵐ_elements@L2)
lastItem = List.LastItem(list=ʳʰʸᵗʰᵐ_elements@L2)
mul = firstItem * lastItem
clear_list = Custom[Clear List](input=mul)  # package archi-lab.net; This node will remove all Null and Empty Lists from any list.
sum = Math.Sum(values=clear_list)
round = Math.Round(number=sum)

# group: Gesamt Fläche
# Beschreibung <Hier doppelklicken, um die Gruppenbeschreibung zu bearbeiten>
aussparungen_fläche_watch = Watch(round)  # graph output

# group: Wandzahl
# Beschreibung <Hier doppelklicken, um die Gruppenbeschreibung zu bearbeiten>
count = List.Count(list=all_elements_of_category)
wandzahl_watch = Watch(count)  # graph output
