# Dynamo graph NP_DP_Fläche_Rechnen_Aussparungen-nachWandkategorie.dyn (Dynamo 2.19.3.6394)
# packages: Rhythm 2025.10.3, archi-lab.net 2025.300.1225

categories = Categories("OST_Walls")
all_elements_of_category = ElementsOfCategory(Category=categories)
name = ElementType.Name(elementType=all_elements_of_category)
string_from_object = FromObject(object=name)
wandkategorie_filterwert_string = StringInput("STB")  # graph input
boolean = BoolSelector(true)
contains = String.Contains(string=string_from_object, searchFor=wandkategorie_filterwert_string, ignoreCase=boolean)
filterByBoolMask = List.FilterByBoolMask(list=all_elements_of_category, mask=contains)
boolean_2 = BoolSelector(true)
boolean_3 = BoolSelector(false)
getHostedElements = Element.GetHostedElements(element=filterByBoolMask.in, includeOpenings=boolean_2, includeHostedElementsOfJoinedHosts=boolean_3, includeEmbeddedWalls=boolean_3, includeSharedEmbeddedInserts=boolean_3)
flatten = List.Flatten(list=getHostedElements)
code_block = CodeBlock { ["Höhe","Breite"]; }
ʳʰʸᵗʰᵐ_elements = Rhythm.Revit.Elements.Elements.GetParameterValueByNameTypeOrInstance(element=flatten@L1, parameterName=code_block)
firstItem = List.FirstItem(list=ʳʰʸᵗʰᵐ_elements@L2)
lastItem = List.LastItem(list=ʳʰʸᵗʰᵐ_elements@L2)
mul = firstItem * lastItem
clear_list = Custom[Clear List](input=mul)  # package archi-lab.net; This node will remove all Null and Empty Lists from any list.
sum = Math.Sum(values=clear_list)
round = Math.Round(number=sum)

# group: Gesamt Fläche
# Beschreibung <Hier doppelklicken, um die Gruppenbeschreibung zu bearbeiten>
aussparungen_fläche_watch = Watch(round)  # graph output

# group: Wandzahl
# Beschreibung <Hier doppelklicken, um die Gruppenbeschreibung zu bearbeiten>
count = List.Count(list=filterByBoolMask.in)
wandzahl_watch = Watch(count)  # graph output
