# Dynamo graph NP_DP_Fläche_Rechnen_Aussparungen-nachWandtyp.dyn (Dynamo 2.19.3.6394)
# packages: Rhythm 2025.10.3

categories = Categories("OST_Walls")
all_elements_of_category = ElementsOfCategory(Category=categories)
name = ElementType.Name(elementType=all_elements_of_category)

# group: Wandtyp
# den Wandtyp auswählen, an dem die Türen angebracht sind
wandtyp = WallTypes("NP_I_W_Mauerwerk_KS_F90_17.5")  # graph input

name_2 = ElementType.Name(elementType=wandtyp)
eq = name == name_2
filterByBoolMask = List.FilterByBoolMask(list=all_elements_of_category, mask=eq)
boolean = BoolSelector(true)
boolean_2 = BoolSelector(false)
getHostedElements = Element.GetHostedElements(element=filterByBoolMask.in, includeOpenings=boolean, includeHostedElementsOfJoinedHosts=boolean_2, includeEmbeddedWalls=boolean_2, includeSharedEmbeddedInserts=boolean_2)
flatten = List.Flatten(list=getHostedElements)
code_block = CodeBlock { ["Höhe","Breite"]; }
ʳʰʸᵗʰᵐ_elements = Rhythm.Revit.Elements.Elements.GetParameterValueByNameTypeOrInstance(element=flatten@L1, parameterName=code_block)
firstItem = List.FirstItem(list=ʳʰʸᵗʰᵐ_elements@L2)
lastItem = List.LastItem(list=ʳʰʸᵗʰᵐ_elements@L2)
mul = firstItem * lastItem
sum = Math.Sum(values=mul)
round = Math.Round(number=sum)

# group: Gesamt Fläche
# Beschreibung <Hier doppelklicken, um die Gruppenbeschreibung zu bearbeiten>
aussparungen_fläche_watch = Watch(round)  # graph output

# group: Wandzahl
# Beschreibung <Hier doppelklicken, um die Gruppenbeschreibung zu bearbeiten>
count = List.Count(list=filterByBoolMask.in)
wandzahl_watch = Watch(count)  # graph output
