# Dynamo graph NP_DP_Geschossdecken_Export_Konstruktion-Excel.dyn (Dynamo 2.19.3.6394)
# packages: Genius Loci 2024.5.29, archi-lab.net 2025.300.1225

code_block = CodeBlock()  # unwired: input
# ---------- code_block.designscript (3 lines) ----------
input == "Null" ? "N/A" :
input == "null" ? "N/A" :
input;
# ----------------------------------------
file_path = Filename("Keine Datei ausgewählt.")  # graph input
string = StringInput("Tabelle1")
number_slider = DoubleSlider(1, range=0..100 step 0.1)
categories = Categories("OST_Floors")
all_elements_of_category = ElementsOfCategory(Category=categories)
get_compoundstructurelayers = Custom[Get CompoundStructureLayers](ElementOrFamilyType=all_elements_of_category)  # package Genius Loci; Retrieves the properties of the compound layers of wall, floor, roof or ceiling Type.
flatten = List.Flatten(list=get_compoundstructurelayers.LayerFunction)
name = Material.Name(material=get_compoundstructurelayers.Material)
flatten_2 = List.Flatten(list=name)
flatten_3 = List.Flatten(list=get_compoundstructurelayers.Thickness)
flatten_4 = List.Flatten(list=get_compoundstructurelayers.Layers)
flatten_5 = List.Flatten(list=get_compoundstructurelayers.IsCoreLayer)
list_create = List.Create(item0=flatten, item1=flatten_2, item2=flatten_3, item3=flatten_4, item4=flatten_5)
string_from_object = FromObject(object=list_create)
transpose = List.Transpose(lists=string_from_object)
string_2 = StringInput("N/A")
replaceNull = archilab.Lists.Lists.ReplaceNull(list=transpose, replacement=string_2)
boolean = BoolSelector(true)
boolean_2 = BoolSelector(true)
exportToExcel = Data.ExportToExcel(filePath=file_path, sheetName=string, startRow=number_slider, startColumn=number_slider, data=replaceNull, overWrite=boolean, writeAsString=boolean_2)
