# Dynamo graph NP_DP_Kollision_Join_nachBauteil.dyn (Dynamo 2.19.3.6394)
# packages: Clockwork for Dynamo 2.x 2.3.0

list_create = List.Create()  # unwired: item0, item1
categories = Categories("OST_Walls")
all_elements_of_category = ElementsOfCategory(Category=categories)
categories_2 = Categories("OST_StructuralColumns")
all_elements_of_category_2 = ElementsOfCategory(Category=categories_2)
cartesianProduct = List.CartesianProduct(combineFunction=list_create, list0=all_elements_of_category, list1=all_elements_of_category_2)
flatten = List.Flatten(list=cartesianProduct@L2)
geometry = Element.Geometry(element=all_elements_of_category)
geometry_2 = Element.Geometry(element=all_elements_of_category_2)
doesIntersect = Geometry.DoesIntersect(geometry=geometry, other=geometry_2, lacing=CrossProduct)
flatten_2 = List.Flatten(list=doesIntersect)
filterByBoolMask = List.FilterByBoolMask(list=flatten, mask=flatten_2)
firstItem = List.FirstItem(list=filterByBoolMask.in@L2)
lastItem = List.LastItem(list=filterByBoolMask.in@L2)

# group: Join Option
# Beschreibung <Hier doppelklicken, um die Gruppenbeschreibung zu bearbeiten>
joinGeometry = Custom[Element.JoinGeometry](element1=firstItem, element2=lastItem)  # package Clockwork for Dynamo 2.x; Joins two model elements (if possible). Only works inside the project environment.
areJoined = Element.AreJoined(element=firstItem, otherElement=lastItem)
