# Dynamo graph NP_DP_Kollision_Split_nachBauteil.dyn (Dynamo 2.19.3.6394)
# packages: Genius Loci 2024.5.29, archi-lab.net 2025.300.1225, Rhythm 2025.10.3

list_create = List.Create()  # unwired: item0, item1
categories = Categories("OST_Walls")
all_elements_of_category = ElementsOfCategory(Category=categories)
categories_2 = Categories("OST_StructuralColumns")
all_elements_of_category_2 = ElementsOfCategory(Category=categories_2)
cartesianProduct = List.CartesianProduct(combineFunction=list_create, list0=all_elements_of_category, list1=all_elements_of_category_2)
flatten = List.Flatten(list=cartesianProduct@L2)
geometry = Element.Geometry(element=all_elements_of_category)
geometry_2 = Element.Geometry(element=all_elements_of_category_2)
doesIntersect = Geometry.DoesIntersect(geometry=geometry, other=geometry_2, lacing=CrossProduct)
flatten_2 = List.Flatten(list=doesIntersect)
filterByBoolMask = List.FilterByBoolMask(list=flatten, mask=flatten_2)
firstItem = List.FirstItem(list=filterByBoolMask.in@L2)
lastItem = List.LastItem(list=filterByBoolMask.in@L2)

# group: Split Option
# Beschreibung <Hier doppelklicken, um die Gruppenbeschreibung zu bearbeiten>
list_create_2 = List.Create()  # unwired: item0, item1
location = archilab.Revit.Elements.Elements.Location(element=firstItem)
boundingBox = Element.BoundingBox(element=lastItem)
minPoint = BoundingBox.MinPoint(boundingBox=boundingBox)
closestPointTo = Geometry.ClosestPointTo(geometry=location.Line, other=minPoint)
ʳʰʸᵗʰᵐ_point_deconstruct = Rhythm.Geometry.Point.Deconstruct(point=closestPointTo)
startPoint = Curve.StartPoint(curve=location.Line)
Z = Point.Z(point=startPoint)
byCoordinates = Point.ByCoordinates(x=ʳʰʸᵗʰᵐ_point_deconstruct.x, y=ʳʰʸᵗʰᵐ_point_deconstruct.y, z=Z)
split_bypoints = Custom[Split ByPoints](element=firstItem, point=byCoordinates)  # package Genius Loci; Split linear elements by points (duct, pipe, column, beam and wall). As many elements as points are required. Works only in Revit 2017 and later.
maxPoint = BoundingBox.MaxPoint(boundingBox=boundingBox)
closestPointTo_2 = Geometry.ClosestPointTo(geometry=location.Line, other=maxPoint)
ʳʰʸᵗʰᵐ_point_deconstruct_2 = Rhythm.Geometry.Point.Deconstruct(point=closestPointTo_2)
startPoint_2 = Curve.StartPoint(curve=location.Line)
Z_2 = Point.Z(point=startPoint_2)
byCoordinates_2 = Point.ByCoordinates(x=ʳʰʸᵗʰᵐ_point_deconstruct_2.x, y=ʳʰʸᵗʰᵐ_point_deconstruct_2.y, z=Z_2)
split_bypoints_2 = Custom[Split ByPoints](element=split_bypoints.Children, point=byCoordinates_2)
laceShortest = List.LaceShortest(combineFunction=list_create_2, list0=split_bypoints_2.Parents, list1=split_bypoints_2.Children)
location_2 = archilab.Revit.Elements.Elements.Location(element=laceShortest)
length = Curve.Length(curve=location_2.Line)
python_script = Python(IN[0]=laceShortest, IN[1]=length)  # CPython3
# ---------- python_script.python (9 lines) ----------
walls = IN[0]   # nested list of wall pairs from LaceShortest
lengths = IN[1] # nested list of lengths

results = []
for wall_group, length_group in zip(walls, lengths):
    min_index = length_group.index(min(length_group))
    results.append(wall_group[min_index])

OUT = results
# ----------------------------------------
delete = archilab.Revit.Elements.Elements.Delete(element=python_script)
