# Dynamo graph NP_DP_Parameter_Export_WertenachParameterName.dyn "NP_DP_Parameter_Wert_ExcelExport" (Dynamo 2.19.3.6394)

datei_ablage_ort_file_path = StringInput("C:\Users\m.elsayed\OneDrive - Nickl-Architekten\Desktop\Scripts\Excel Sheets")  # "Datei Ablage Ort (File path) - String"; graph input
excel_datei_seite_name_string = StringInput("NP_Tür_iBO_Values")  # graph input
integer_slider = IntegerSlider(0, range=0..100 step 1)
integer_slider_2 = IntegerSlider(0, range=0..100 step 1)
categories = Categories("OST_Doors")  # graph input
all_elements_of_category = ElementsOfCategory(Category=categories)
quellparameter_string = StringInput("NP_Tür_iBO_Funktion")  # graph input
getParameterValueByName = Element.GetParameterValueByName(element=all_elements_of_category, parameterName=quellparameter_string)
boolean = BoolSelector(true)
boolean_2 = BoolSelector(true)
exportToExcel = Data.ExportToExcel(filePath=datei_ablage_ort_file_path, sheetName=excel_datei_seite_name_string, startRow=integer_slider, startColumn=integer_slider_2, data=getParameterValueByName, overWrite=boolean, writeAsString=boolean_2)
