# Dynamo graph NP_DP_Parameter_Export_nachAusgewählteBauteil-ExcelDatei.dyn "NP_DP_Parameter_Export_nachBauteil-ExcelDatei" (Dynamo 2.19.3.6394)

file_path = Filename("Keine Datei ausgewählt.")
string = StringInput("Parameter Liste")
number_slider = DoubleSlider(0, range=0..100 step 0.1)
select_model_elements = DSModelElementsSelection()  # nothing selected; graph input
parameters = Element.Parameters(element=select_model_elements)
boolean = BoolSelector(true)
exportToExcel = Data.ExportToExcel(filePath=file_path, sheetName=string, startRow=number_slider, startColumn=number_slider, data=parameters, overWrite=boolean, writeAsString=boolean)
