# Dynamo graph NP_DP_Parameter_Export_nachBauteil-ExcelDatei.dyn "Export multiple parameters to excel" (Dynamo 2.19.3.6394)
# packages: Rhythm 2025.10.3

file_path = Filename("..\Excel Sheets\try")  # graph input
string = StringInput("Tabelle1")
number_slider = DoubleSlider(0, range=0..100 step 0.1)
categories = Categories("OST_Doors")  # graph input
all_elements_of_category = ElementsOfCategory(Category=categories)
parametername_string = StringInput("NP_Bauteil,NP_Raumnummer,NP_Tür_Schloss,NP_Tür_Schleuse")  # graph input
string_2 = StringInput(",")
split = String.Split(string=parametername_string, separator0=string_2)
trimWhitespace = String.TrimWhitespace(string=split)
ʳʰʸᵗʰᵐ_elements = Rhythm.Revit.Elements.Elements.GetParameterValueByNameTypeOrInstance(element=all_elements_of_category@L1, parameterName=trimWhitespace)
boolean = BoolSelector(true)
exportToExcel = Data.ExportToExcel(filePath=file_path, sheetName=string, startRow=number_slider, startColumn=number_slider, data=ʳʰʸᵗʰᵐ_elements, overWrite=boolean, writeAsString=boolean)
