# Dynamo graph NP_DP_Parameter_WertSetzen_Binary-Boolean.dyn "NP_DP_Parameter_WertUebertragen_Binary-Boolean" (Dynamo 2.19.3.6394)
# packages: Clockwork for Dynamo 2.x 2.3.0

categories = Categories("OST_Doors")  # graph input
all_elements_of_category = ElementsOfCategory(Category=categories)
quellparameter_string = StringInput("IDS_Fluchtweg")  # graph input
getParameterValueByName = Element.GetParameterValueByName(element=all_elements_of_category, parameterName=quellparameter_string)
string_from_object = FromObject(object=getParameterValueByName)
toBooleans = Custom[Binary.ToBooleans](str=string_from_object)  # package Clockwork for Dynamo 2.x; Converts a binary string to a list of booleans
flatten = List.Flatten(list=toBooleans)
filterByBoolMask = List.FilterByBoolMask(list=all_elements_of_category, mask=flatten)
zielparameter_string = StringInput("NP_Tür_Fluchtwegsicherung")  # graph input
zielwert_string = StringInput("Ja")  # graph input
setParameterByName = Element.SetParameterByName(element=filterByBoolMask.in, parameterName=zielparameter_string, value=zielwert_string)
