# Dynamo graph NP_DP_Parameter_WertSetzen_Exemplar-Exemplar (FilterFunktion).dyn (Dynamo 2.19.3.6394)
# packages: Crumple 2024.4.3

categories = Categories("OST_Doors")  # graph input
all_elements_of_category = ElementsOfCategory(Category=categories)
quellparameter_string = StringInput("NP_Flucht_Tür")  # graph input
getParameterValueByName = Element.GetParameterValueByName(element=all_elements_of_category, parameterName=quellparameter_string)
string_from_object = FromObject(object=getParameterValueByName)
filterwert_string = StringInput("Nein")  # graph input
contains = String.Contains(string=string_from_object, searchFor=filterwert_string)
filterByBoolMask = List.FilterByBoolMask(list=all_elements_of_category, mask=contains)
zielparameter_string = StringInput("NP_Flucht_Tür_Terminal")  # graph input
zielwert_string = StringInput("-")  # graph input
setParameterByName = Element.SetParameterByName(element=filterByBoolMask.in, parameterName=zielparameter_string, value=zielwert_string)
elements_select = Custom[© Elements.Select]()  # package Crumple; Given a list of elements, select them in the Revit document.; unwired: elements
categories_2 = Categories("OST_Doors")
all_elements_of_category_2 = ElementsOfCategory(Category=categories_2)
