# Dynamo graph NP_DP_Parameter_WertSetzen_Null-ZielWert(Exemplar).dyn (Dynamo 2.19.3.6394)
# packages: Clockwork for Dynamo 2.x 2.3.0

# group: Replace Null Values with a Fixed Value in an Instance Parameter
# Beschreibung <Hier doppelklicken, um die Gruppenbeschreibung zu bearbeiten>
categories = Categories("OST_Doors")  # graph input
all_elements_of_category = ElementsOfCategory(Category=categories)
parameter_string = StringInput("NP_Tür_Drückergarnitur_BGS")  # graph input
getParameterValueByName = Element.GetParameterValueByName(element=all_elements_of_category, parameterName=parameter_string)
python_script = Python(IN[0]=getParameterValueByName)  # CPython3
# ---------- python_script.python (27 lines) ----------
# Import necessary libraries
import clr
clr.AddReference('RevitServices')
from RevitServices.Persistence import DocumentManager
from RevitServices.Transactions import TransactionManager

# Import Revit's NULL value
clr.AddReference('RevitNodes')
import Revit
from Revit.Elements import *

# Get the Dynamo Null value
null_value = None  # Dynamo treats None as Null

# Inputs:
# IN[0]: A list of elements to analyze
data_list = IN[0]

# Function to replace empty values with Null
def replace_empty(value):
    return null_value if value in [None, "", " "] or str(value).strip() == "" else value

# Process the list
output = [replace_empty(item) for item in data_list]

# Output the modified list
OUT = output
# ----------------------------------------
wert_angabe_string = StringInput("Angabe folgt")  # graph input
replaceNull = Custom[List.ReplaceNull](seq=python_script, replacement=wert_angabe_string)  # package Clockwork for Dynamo 2.x; Replaces all null values within a given list with a substitute
setParameterByName = Element.SetParameterByName(element=all_elements_of_category, parameterName=parameter_string, value=replaceNull)
