# Dynamo graph NP_DP_Parameter_WertSetzen_Null-ZielWert(Typ).dyn (Dynamo 2.19.3.6394)
# packages: Clockwork for Dynamo 2.x 2.3.0, archi-lab.net 2025.300.1225

# group: Replace Null Values with a Fixed Value in a Type Parameter
# Beschreibung <Hier doppelklicken, um die Gruppenbeschreibung zu bearbeiten>
categories = Categories("OST_Doors")  # graph input
all_elements_of_category = ElementsOfCategory(Category=categories)
elementType = Element.ElementType(element=all_elements_of_category)
parameter_string = StringInput("NP_Bauteiltyp")  # graph input
get_type_parameter = Custom[Get Type Parameter](element=all_elements_of_category, parameterName=parameter_string)  # package archi-lab.net; This node will retrieve a type parameter by its name.
python_script = Python(IN[0]=get_type_parameter)  # CPython3
# ---------- python_script.python (27 lines) ----------
# Import necessary libraries
import clr
clr.AddReference('RevitServices')
from RevitServices.Persistence import DocumentManager
from RevitServices.Transactions import TransactionManager

# Import Revit's NULL value
clr.AddReference('RevitNodes')
import Revit
from Revit.Elements import *

# Get the Dynamo Null value
null_value = None  # Dynamo treats None as Null

# Inputs:
# IN[0]: A list of elements to analyze
data_list = IN[0]

# Function to replace empty values with Null
def replace_empty(value):
    return null_value if value in [None, "", " "] or str(value).strip() == "" else value

# Process the list
output = [replace_empty(item) for item in data_list]

# Output the modified list
OUT = output
# ----------------------------------------
wert_angabe_string = StringInput("T")  # graph input
replaceNull = Custom[List.ReplaceNull](seq=python_script, replacement=wert_angabe_string)  # package Clockwork for Dynamo 2.x; Replaces all null values within a given list with a substitute
setParameterByName = Element.SetParameterByName(element=elementType, parameterName=parameter_string, value=replaceNull)
