# Dynamo graph NP_DP_Parameter_WertUebertragen_Basisbauteil-Bauteil.dyn (Dynamo 2.19.3.6394)
# packages: archi-lab.net 2025.300.1225

categories = Categories("OST_Doors")  # graph input
all_elements_of_category = ElementsOfCategory(Category=categories)
type = archilab.Revit.Elements.Elements.Type(element=all_elements_of_category)
familyName = ElementType.FamilyName(elementType=type)
string_from_object = FromObject(object=familyName)
string = StringInput("Wandöffnung")
boolean = BoolSelector(true)
contains = String.Contains(string=string_from_object, searchFor=string, ignoreCase=boolean)
filterByBoolMask = List.FilterByBoolMask(list=all_elements_of_category, mask=contains)
bauteilparameter_string = StringInput("NP_Material_Wand")  # graph input
get_host_element = Custom[Get Host Element](hostedElement=filterByBoolMask.out)  # package archi-lab.net; This node will retrieve a host element from hosted element. Ex. feed in door, get wall.
type_2 = archilab.Revit.Elements.Elements.Type(element=get_host_element)
basisbauteilparameter_string = StringInput("NP_Material")  # graph input
getParameterValueByName = Element.GetParameterValueByName(element=type_2, parameterName=basisbauteilparameter_string)
string_from_object_2 = FromObject(object=getParameterValueByName)
setParameterByName = Element.SetParameterByName(element=filterByBoolMask.out, parameterName=bauteilparameter_string, value=string_from_object_2)
