# Dynamo graph NP_DP_Parameter_WertUebertragen_Bauteil-Bauteil(AlleParameter).dyn "NP_DP_Parameter_WertUebertragen_Element-Element(AlleParameter) (INCOMPLETE)" (Dynamo 2.19.3.6394)

ziel_element_auswählen = DSModelElementSelection()  # 1 picked in the model; graph input
quell_element_auswählen = DSModelElementSelection()  # 1 picked in the model; graph input
parameters = Element.Parameters(element=quell_element_auswählen)
hasValue = Parameter.HasValue(parameter=parameters)
filterByBoolMask = List.FilterByBoolMask(list=parameters, mask=hasValue)
string_from_object = FromObject(object=filterByBoolMask.in)
string = StringInput(":")
split = String.Split(string=string_from_object, separator0=string)
firstItem = List.FirstItem(list=split@L2)
trimTrailingWhitespace = String.TrimTrailingWhitespace(string=firstItem)
code_block = CodeBlock { ["Familie","Typ","Bauteil","Host"]; }
python_script = Python(IN[0]=trimTrailingWhitespace, IN[1]=code_block)  # CPython3
# ---------- python_script.python (14 lines) ----------
A = IN[0]  # list of strings to search IN
B = IN[1]  # list of keywords to search FOR

S = []

for a in A:
    found = False
    for b in B:
        if b in a:
            found = True
            break
    S.append(found)

OUT = S
# ----------------------------------------
filterByBoolMask_2 = List.FilterByBoolMask(list=trimTrailingWhitespace, mask=python_script)
getParameterValueByName = Element.GetParameterValueByName(element=quell_element_auswählen, parameterName=filterByBoolMask_2.out)
setParameterByName = Element.SetParameterByName(element=ziel_element_auswählen, parameterName=filterByBoolMask_2.out, value=getParameterValueByName)
python_script_2 = Python()  # CPython3; unwired: IN[0], IN[1]
# ---------- python_script_2.python (10 lines) ----------
A=IN[0]
B=IN[1]

S=[]
for a in A:
	if a in B:
		S.append(True)
	else:
		S.append(False)
OUT=S
# ----------------------------------------
