# Dynamo graph NP_DP_Parameter_WertUebertragen_Exemplar-Exemplar.dyn "NP_DP_Parameter_WerteUebertragen_Exemplar-Exemplar" (Dynamo 2.19.3.6394)

# group: Value Transfer from one Parameter to another
# Beschreibung <Hier doppelklicken, um die Gruppenbeschreibung zu bearbeiten>
categories = Categories("OST_Doors")  # graph input
all_elements_of_category = ElementsOfCategory(Category=categories)
zielparameter_string = StringInput("NP_Tür_Bediengeräteschlüssel")  # graph input
quellparameter_string = StringInput("NP_Tür_ZK_Taster_BGS")  # graph input
getParameterValueByName = Element.GetParameterValueByName(element=all_elements_of_category, parameterName=quellparameter_string)
setParameterByName = Element.SetParameterByName(element=all_elements_of_category, parameterName=zielparameter_string, value=getParameterValueByName)
