# Dynamo graph NP_DP_Parameter_WertUebertragen_Exemplar-Typ.dyn (Dynamo 2.19.3.6394)

# group: Transfer Value from Instance Parameter to Type Parameter
# Beschreibung <Hier doppelklicken, um die Gruppenbeschreibung zu bearbeiten>
categories = Categories("OST_Doors")  # graph input
all_elements_of_category = ElementsOfCategory(Category=categories)
elementType = Element.ElementType(element=all_elements_of_category)
zielparameter_string = StringInput("")  # graph input
quellparameter_string = StringInput("")  # graph input
getParameterValueByName = Element.GetParameterValueByName(element=all_elements_of_category, parameterName=quellparameter_string)
setParameterByName = Element.SetParameterByName(element=elementType, parameterName=zielparameter_string, value=getParameterValueByName)
