# Dynamo graph NP_DP_Parameter_WertUebertragen_Typ-Exemplar.dyn (Dynamo 2.19.3.6394)
# packages: archi-lab.net 2025.300.1225

# group: Transfer Value from Type Parameter to Instance Parameter
# Beschreibung <Hier doppelklicken, um die Gruppenbeschreibung zu bearbeiten>
categories = Categories("OST_Doors")  # graph input
all_elements_of_category = ElementsOfCategory(Category=categories)
zielparameter_string = StringInput("")  # graph input
quellparameter_string = StringInput("")  # graph input
get_type_parameter = Custom[Get Type Parameter](element=all_elements_of_category, parameterName=quellparameter_string)  # package archi-lab.net; This node will retrieve a type parameter by its name.
setParameterByName = Element.SetParameterByName(element=all_elements_of_category, parameterName=zielparameter_string, value=get_type_parameter)
