# Dynamo graph NP_DP_Parameter_WertUebertragen_Typ-Typ.dyn (Dynamo 2.19.3.6394)
# packages: archi-lab.net 2025.300.1225

# group: Transfer Value from Type Parameter to another
# Beschreibung <Hier doppelklicken, um die Gruppenbeschreibung zu bearbeiten>
categories = Categories("OST_Doors")  # graph input
all_elements_of_category = ElementsOfCategory(Category=categories)
elementType = Element.ElementType(element=all_elements_of_category)
zielparameter_string = StringInput("NP_Türblattmaterial")  # graph input
quellparameter_string = StringInput("NP_Bauteiltyp")  # graph input
get_type_parameter = Custom[Get Type Parameter](element=all_elements_of_category, parameterName=quellparameter_string)  # package archi-lab.net; This node will retrieve a type parameter by its name.
setParameterByName = Element.SetParameterByName(element=elementType, parameterName=zielparameter_string, value=get_type_parameter)
