# Dynamo graph NP_DP_Parameter_WerteKombinieren_ParameterWerte-ZielParameter.dyn (Dynamo 2.19.3.6394)
# packages: Crumple 2024.4.3, Rhythm 2025.10.3

categories = Categories("OST_Doors")  # graph input
all_elements_of_category = ElementsOfCategory(Category=categories)
zielparameter_string = StringInput("NP_Name/Nummer/Stempel")  # graph input
parameternamen_string = StringInput("NP_Tür_Ebene,IDS_Brandabschnitt_Nummer,NP_Laufende_Türnummer,NP_Bauteiltyp,NP_Raumnummer")  # graph input
string = StringInput(",")
split = String.Split(string=parameternamen_string, separator0=string)
trimWhitespace = String.TrimWhitespace(string=split)
ʳʰʸᵗʰᵐ_elements = Rhythm.Revit.Elements.Elements.GetParameterValueByNameTypeOrInstance(element=all_elements_of_category, parameterName=trimWhitespace@L1)
transpose = List.Transpose(lists=ʳʰʸᵗʰᵐ_elements)
separator_string = StringInput("_")  # graph input
string_join = Custom[© String.Join](list=transpose@L2, sep=separator_string)  # package Crumple; Joins a list of strings together, inserting a separating character between each of them. Input must be a list containing a list or lists.
setParameterByName = Element.SetParameterByName(element=all_elements_of_category, parameterName=zielparameter_string, value=string_join)
