# Dynamo graph NP_DP_Parameter_Wertsetzen_ExcelImport.dyn (Dynamo 2.19.3.6394)

categories = Categories("OST_Doors")  # graph input
all_elements_of_category = ElementsOfCategory(Category=categories)
zielparameter_string = StringInput("NP_Tür_iBO_Funktion")  # graph input
date_ablage_ort_file_path_string = StringInput("C:\Users\m.elsayed\OneDrive - Nickl-Architekten\Desktop\Scripts\Excel Sheets\NP_Tür_Values.xlsx")  # graph input
file_from_path = FileObject(path=date_ablage_ort_file_path_string)
boolean = BoolSelector(true)
importExcel = Data.ImportExcel(file=file_from_path, readAsStrings=boolean)  # unwired: sheetName
flatten = List.Flatten(list=importExcel)
setParameterByName = Element.SetParameterByName(element=all_elements_of_category, parameterName=zielparameter_string, value=flatten)
