# Dynamo graph NP_DP_Parameter_Wertsetzen_Raum-Boden-Decken(nachBauteilKategorie).dyn (Dynamo 2.19.3.6394)
# packages: Data-Shapes 2022.2.103, Rhythm 2025.10.3, Crumple 2024.4.3

rooms_by_status = RoomsByStatus()
raum_parametername_string = StringInput("NP_Boden/Decken Typ")  # graph input
location = Room.Location(room=rooms_by_status.PlacedRooms)
number_slider = DoubleSlider(1, range=0..100 step 0.1)
translate = Geometry.Translate(geometry=location, zTranslation=number_slider)
decken_true_boden_false_boolean = BoolSelector(false)  # graph input
ZAxis = Vector.ZAxis()
reverse = Vector.Reverse(vector=ZAxis)
flow_ifthenelse = Custom[© Flow.IfThenElse](If=decken_true_boden_false_boolean, Then=ZAxis, Else=reverse)  # package Crumple; A simple if/then/else logic gate. If true, you get the 'then' input, otherwise you get the 'else' input. Unlike the OOTB 'If' node, this one allows differing list sizes.
n3d_ansicht_auswählen_views = Views("{3d -m.elsayedSALRE}")  # "3D Ansicht auswählen - Views"; graph input
categories = Categories("OST_Floors")  # graph input
rvt_verknüpfungen_true_rvt = BoolSelector(false)  # "RVT Verknüpfungen (True), RVT Aktuell Datei (False) - Boolean"; graph input
raybounce_on_link_category = Custom[RayBounce On Link Category](Points=translate, Direction=flow_ifthenelse, ThreeDView=n3d_ansicht_auswählen_views, Category=categories, BounceOnLinksOnly=rvt_verknüpfungen_true_rvt)  # package Data-Shapes; Same functionality as raybounce but takes linked model elements into account
boden_decken_parametername = StringInput("NP_Material")  # "Boden/Decken Parametername - String"; graph input
ʳʰʸᵗʰᵐ_elements = Rhythm.Revit.Elements.Elements.GetParameterValueByNameTypeOrInstance(element=raybounce_on_link_category.Elements, parameterName=boden_decken_parametername)
setParameterByName = Element.SetParameterByName(element=rooms_by_status.PlacedRooms, parameterName=raum_parametername_string, value=ʳʰʸᵗʰᵐ_elements)
