# Dynamo graph NP_DP_Parameter_Wertsetzen_Raum-Boden-Decken.dyn (Dynamo 2.19.3.6394)
# packages: Rhythm 2025.10.3, Crumple 2024.4.3

rooms_by_status = RoomsByStatus()
raum_parametername_string = StringInput("NP_Boden/Decken Typ")  # graph input
location = Room.Location(room=rooms_by_status.PlacedRooms)
number_slider = DoubleSlider(1, range=0..100 step 0.1)
translate = Geometry.Translate(geometry=location, zTranslation=number_slider)
decken_true_boden_false_boolean = BoolSelector(false)  # graph input
ZAxis = Vector.ZAxis()
reverse = Vector.Reverse(vector=ZAxis)
flow_ifthenelse = Custom[© Flow.IfThenElse](If=decken_true_boden_false_boolean, Then=ZAxis, Else=reverse)  # package Crumple; A simple if/then/else logic gate. If true, you get the 'then' input, otherwise you get the 'else' input. Unlike the OOTB 'If' node, this one allows differing list sizes.
number_slider_2 = DoubleSlider(1, range=0..100 step 0.1)
n3d_ansicht_auswählen_views = Views("{3d -m.elsayedSALRE}")  # "3D Ansicht auswählen - Views"; graph input
byOriginDirection = Revit.References.RayBounce.ByOriginDirection(origin=translate, direction=flow_ifthenelse, maxBounces=number_slider_2, view=n3d_ansicht_auswählen_views)
flatten = List.Flatten(list=byOriginDirection.elements)
boden_decken_parametername = StringInput("NP_Material")  # "Boden/Decken Parametername - String"; graph input
ʳʰʸᵗʰᵐ_elements = Rhythm.Revit.Elements.Elements.GetParameterValueByNameTypeOrInstance(element=flatten, parameterName=boden_decken_parametername)
setParameterByName = Element.SetParameterByName(element=rooms_by_status.PlacedRooms, parameterName=raum_parametername_string, value=ʳʰʸᵗʰᵐ_elements)
