# Dynamo graph NP_DP_Plan_Duplizieren_ExcelDatei(Plannummer).dyn (Dynamo 2.19.3.6394)
# packages: bimorphNodes 4.1.2, Crumple 2024.4.3, archi-lab.net 2025.300.1225

current_document = Custom[Current Document]()  # package archi-lab.net; Retrieves Current Document
collect_sheets = Custom[© Collect.Sheets](docOrLink=current_document)  # package Crumple; Returns all the sheets in a document, with the option to omit any placeholder sheets.
sheetNumber = Sheet.SheetNumber(sheet=collect_sheets)
file_path = Filename("C:\Users\m.elsayed\OneDrive - Nickl-Architekten\Desktop\Scripts\Excel Sheets\Create sheets test.xlsx")  # graph input
file_from_path = FileObject(path=file_path)
excel_tabelle_string = StringInput("Tabelle1")  # graph input
boolean = BoolSelector(true)
importExcel = Data.ImportExcel(file=file_from_path, sheetName=excel_tabelle_string, readAsStrings=boolean)
transpose = List.Transpose(lists=importExcel)
code_block = CodeBlock(x=transpose) { x[0]; x[1]; x[2]; }
python_script = Python(IN[0]=sheetNumber, IN[1]=code_block.out0)  # CPython3
# ---------- python_script.python (10 lines) ----------
A=IN[0]
B=IN[1]

S=[]
for a in A:
	if a in B:
		S.append(True)
	else:
		S.append(False)
OUT=S
# ----------------------------------------
filterByBoolMask = List.FilterByBoolMask(list=collect_sheets, mask=python_script)
boolean_2 = BoolSelector(true)
inkl_anischtduplizieren_true = BoolSelector(true)  # "inkl.AnischtDuplizieren (True), OhneAnischtDuplizieren (False) - Boolean"; graph input
mit_detailierung_duplizieren = BoolSelector(true)  # "Mit Detailierung Duplizieren (True), Ohne (False) - Boolean"; graph input
integer_slider = IntegerSlider(1, range=0..100 step 1)
integer_slider_2 = IntegerSlider(0, range=0..100 step 1)
flow_ifthenelse = Custom[© Flow.IfThenElse](If=mit_detailierung_duplizieren, Then=integer_slider, Else=integer_slider_2)  # package Crumple; A simple if/then/else logic gate. If true, you get the 'then' input, otherwise you get the 'else' input. Unlike the OOTB 'If' node, this one allows differing list sizes.
suffix_string = StringInput("_DUP")  # graph input
präfix_string = StringInput("DUP_")  # graph input
duplicate = Revit.Sheet.Duplicate(sheets=filterByBoolMask.in, run=boolean_2, duplicateWithViews=inkl_anischtduplizieren_true, duplicateOption=flow_ifthenelse, suffix=suffix_string, prefix=präfix_string)
