# Dynamo graph NP_DP_Plan_Erstellen_ExcelDatei(Planname-Plannummer-Ansichten).dyn (Dynamo 2.19.3.6394)

excel_datei_auswähle_file_path = Filename("C:\Users\m.elsayed\OneDrive - Nickl-Architekten\Desktop\Scripts\Excel Sheets\Create sheets test.xlsx")  # graph input
file_from_path = FileObject(path=excel_datei_auswähle_file_path)
excel_tabelle_name_string = StringInput("Tabelle1")  # graph input
boolean = BoolSelector(true)
boolean_2 = BoolSelector(false)
importExcel = Data.ImportExcel(file=file_from_path, sheetName=excel_tabelle_name_string, readAsStrings=boolean, showExcel=boolean_2)
transpose = List.Transpose(lists=importExcel)
code_block = CodeBlock(SheetName=transpose, SheetNumber=transpose, ViewNames=transpose) { SheetName[0]; SheetNumber[1]; ViewNames[2]; }
string = StringInput("1700x841")
byName = FamilyType.ByName(name=string)
categories = Categories("OST_Views")
all_elements_of_category = ElementsOfCategory(Category=categories)
string_2 = StringInput("Ansichtsname")
getParameterValueByName = Element.GetParameterValueByName(element=all_elements_of_category, parameterName=string_2)
python_script = Python(IN[0]=getParameterValueByName, IN[1]=code_block.out2)  # CPython3
# ---------- python_script.python (10 lines) ----------
A=IN[0]
B=IN[1]

S=[]
for a in A:
	if a in B:
		S.append(True)
	else:
		S.append(False)
OUT=S
# ----------------------------------------
filterByBoolMask = List.FilterByBoolMask(list=all_elements_of_category, mask=python_script)
byNameNumberTitleBlockAndView = Sheet.ByNameNumberTitleBlockAndView(sheetName=code_block.out0, sheetNumber=code_block.out1, titleBlockFamilyType=byName, view=filterByBoolMask.in)
