# Dynamo graph NP_DP_Plan_WertSetzen_Plangröße-Planmaße.dyn (Dynamo 2.19.3.6394)
# packages: Crumple 2024.4.3, Zebra 2016.7.2

# group: Optimized Version
# Beschreibung <Hier doppelklicken, um die Gruppenbeschreibung zu bearbeiten>
categories = Categories("OST_Sheets")
all_elements_of_category = ElementsOfCategory(Category=categories)
zielparameter_string = StringInput("Plangröße")  # graph input
sheets_titleblock = Custom[© Sheets.Titleblock](sheets=all_elements_of_category)  # package Crumple; Given a sheet or list of sheets, return any titleblocks on that sheet as well as whether the sheet has titleblocks as a boolean.
quellparameter_string = StringInput("Planbreite,Planhöhe")  # graph input
string = StringInput(",")
split = String.Split(string=quellparameter_string, separator0=string)
trimWhitespace = String.TrimWhitespace(string=split)
getParameterValueByName = Element.GetParameterValueByName(element=sheets_titleblock@L1, parameterName=trimWhitespace)
integer_slider = IntegerSlider(1000, range=0..1000 step 1)
mul = getParameterValueByName * integer_slider
string_from_object = FromObject(object=mul)
string_2 = StringInput(",")
boolean = BoolSelector(true)
removeAfterCharacters = Custom[String.RemoveAfterCharacters](string_from_object, Characters=string_2, includeChar=boolean)  # package Zebra; Removes the part of the string after the input character/s
firstItem = List.FirstItem(list=removeAfterCharacters@L2)
lastItem = List.LastItem(list=removeAfterCharacters@L2)
list_create = List.Create(item0=firstItem, item1=lastItem)
transpose = List.Transpose(lists=list_create)
string_3 = StringInput("x")
string_join = Custom[© String.Join](list=transpose@L2, sep=string_3)  # package Crumple; Joins a list of strings together, inserting a separating character between each of them. Input must be a list containing a list or lists.
setParameterByName = Element.SetParameterByName(element=all_elements_of_category, parameterName=zielparameter_string, value=string_join)
plangröße_watch = Watch(string_join)  # graph output
