# Dynamo graph NP_DP_Planänderung_Entfernen_nachÄnderungsName.dyn (Dynamo 2.19.3.6394)
# packages: archi-lab.net 2025.300.1225

categories = Categories("OST_Sheets")
all_elements_of_category = ElementsOfCategory(Category=categories)
plannummer_parametername_string = StringInput("Plannummer")  # graph input
getParameterValueByName = Element.GetParameterValueByName(element=all_elements_of_category, parameterName=plannummer_parametername_string)
plannummer_als_excel_datei_file = Filename("C:\Users\m.elsayed\OneDrive - Nickl-Architekten\Desktop\Scripts\Excel Sheets\sheets test.xlsx")  # "Plannummer als Excel Datei - File Path"; graph input
file_from_path = FileObject(path=plannummer_als_excel_datei_file)
excel_datei_tabelle_name_string = StringInput("Tabelle1")  # graph input
boolean = BoolSelector(true)
importExcel = Data.ImportExcel(file=file_from_path, sheetName=excel_datei_tabelle_name_string, readAsStrings=boolean)
transpose = List.Transpose(lists=importExcel)
code_block = CodeBlock(x=transpose) { x[0]; }
python_script = Python(IN[0]=getParameterValueByName, IN[1]=code_block)  # IronPython2
# ---------- python_script.python (10 lines) ----------
A=IN[0]
B=IN[1]

S=[]
for a in A:
	if a in B:
		S.append(True)
	else:
		S.append(False)
OUT=S
# ----------------------------------------
filterByBoolMask = List.FilterByBoolMask(list=all_elements_of_category, mask=python_script)
revisions = archilab.Revit.Views.Sheets.Revisions(sheet=filterByBoolMask.in)
id = Element.Id(element=revisions)
planänderung_select_revision = RevitRevisions("Seq. 105 - Abstimmung Türübersichten BH")  # graph input
id_2 = Element.Id(element=planänderung_select_revision)
eq = id == id_2
filterByBoolMask_2 = List.FilterByBoolMask(list=revisions, mask=eq)
boolean_2 = BoolSelector(true)
remove_revision_from_sheet = Custom[Remove Revision from Sheet](sheet=filterByBoolMask.in, revision=filterByBoolMask_2.in@L2, runIt=boolean_2)  # package archi-lab.net; This node will remove specified Revisions from a sheet.
