# Dynamo graph NP_DP_Planänderung_Exportieren_nachPlannummer-ExcelDatei.dyn (Dynamo 2.19.3.6394)
# packages: archi-lab.net 2025.300.1225, Clockwork for Dynamo 2.x 2.3.0

file_path = Filename("Excel Sheets\Fatima Test")
string = StringInput("Änderungswolken")
number_slider = DoubleSlider(1, range=0..100 step 0.1)
number_slider_2 = DoubleSlider(1, range=0..100 step 0.1)
plannummer_string = StringInput("5003,5004")  # graph input
string_2 = StringInput(",")
split = String.Split(string=plannummer_string, separator0=string_2)
categories = Categories("OST_Sheets")
all_elements_of_category = ElementsOfCategory(Category=categories)
string_3 = StringInput("Plannummer")
getParameterValueByName = Element.GetParameterValueByName(element=all_elements_of_category, parameterName=string_3)
python_script = Python(IN[0]=getParameterValueByName, IN[1]=split)  # CPython3
# ---------- python_script.python (10 lines) ----------
A=IN[0]
B=IN[1]

S=[]
for a in A:
	if a in B:
		S.append(True)
	else:
		S.append(False)
OUT=S
# ----------------------------------------
filterByBoolMask = List.FilterByBoolMask(list=all_elements_of_category, mask=python_script)
revisions = archilab.Revit.Views.Sheets.Revisions(sheet=filterByBoolMask.in)
ID = Custom[Element.ID+](element=revisions@L2)  # package Clockwork for Dynamo 2.x; Gets the ID of a given Revit elements. Unlike the OOTB Element.Id node, this node also works on mixed lists of Revit elements and categories.
count = List.Count(list=ID@L2)
ofRepeatedItem = List.OfRepeatedItem(item=split@L1, amount=count@L1)
revision_properties = Custom[Revision Properties](revision=revisions@L2)  # package archi-lab.net; This node will return some most common Revision properties like Description or Issue Date.
list_create = List.Create(item0=ofRepeatedItem, item1=ID, item2=revision_properties.sequence, item3=revision_properties.date, item4=revision_properties.description, item5=revision_properties.issued, item6=revision_properties.issuedBy)
transpose = List.Transpose(lists=list_create)
transpose_2 = List.Transpose(lists=transpose@L3)
number_slider_3 = DoubleSlider(1, range=0..100 step 0.1)
flatten = List.Flatten(list=transpose_2, amount=number_slider_3)
boolean = BoolSelector(true)
exportToExcel = Data.ExportToExcel(filePath=file_path, sheetName=string, startRow=number_slider, startColumn=number_slider_2, data=flatten, overWrite=boolean, writeAsString=boolean)
