# Dynamo graph NP_DP_Türen_WertSetzen_Raumbezeichnung.dyn (Dynamo 2.19.3.6394)
# packages: Clockwork for Dynamo 2.x 2.3.0, Crumple 2024.4.3

categories = Categories("OST_Doors")  # frozen
all_elements_of_category = ElementsOfCategory(Category=categories)
quell_parameter_string = StringInput("NP_Tür_Raumbezeichnung")  # graph input
rooms = Custom[Door.Rooms](door=all_elements_of_category)  # package Clockwork for Dynamo 2.x; Gets the rooms that are connected by a given door
raumname_parameter_string = StringInput("NP_Raumname VS-NfD")  # graph input
getParameterValueByName = Element.GetParameterValueByName(element=rooms.fromRoom, parameterName=raumname_parameter_string)
getParameterValueByName_2 = Element.GetParameterValueByName(element=rooms.toRoom, parameterName=raumname_parameter_string)
list_create = List.Create(item0=getParameterValueByName, item1=getParameterValueByName_2)
transpose = List.Transpose(lists=list_create)
code_block = CodeBlock { " -- "; }
string_join = Custom[© String.Join](list=transpose@L2, sep=code_block)  # package Crumple; Joins a list of strings together, inserting a separating character between each of them. Input must be a list containing a list or lists.
setParameterByName = Element.SetParameterByName(element=all_elements_of_category, parameterName=quell_parameter_string, value=string_join)
