# Dynamo graph NP_D_Bearbeitungsbereich__Steuerung_Complete Set.dyn (Dynamo 2.19.3.6394)
# packages: Genius Loci 2024.5.29, Clockwork for Dynamo 2.x 2.3.0, Rhythm 2025.10.3, Crumple 2024.4.3, archi-lab.net 2025.300.1225

# note: ONLY RUN ONE SCRIPT AT A TIME!!!!!

# group: Sort Elements by Workset
# Beschreibung <Hier doppelklicken, um die Gruppenbeschreibung zu bearbeiten>
categories = Categories("OST_Doors")
all_elements_of_category = ElementsOfCategory(Category=categories)
element_workset = Custom[Element Workset](element=all_elements_of_category)  # package Genius Loci; Returns the workset of the given element.
string = StringInput("03 Türen")
eq = element_workset.Workset_Name == string
filterByBoolMask = List.FilterByBoolMask(list=all_elements_of_category, mask=eq)
string_2 = StringInput("Ausbau")
workset_byname = Custom[Workset ByName](WorksetName=string_2)  # package Genius Loci; Retrieves the workset by the given name.
elements_setworkset = Custom[© Elements.SetWorkset](elements=filterByBoolMask.in, workset=workset_byname.Workset)  # frozen; package Crumple; Given a workset and a list of elements, attempt to set those elements' worksets to it.

# group: Assign Workset to entire category
# Beschreibung <Hier doppelklicken, um die Gruppenbeschreibung zu bearbeiten>
categories_2 = Categories("OST_Doors")
all_elements_of_category_2 = ElementsOfCategory(Category=categories_2)
string_3 = StringInput("03 Türen")
workset_byname_2 = Custom[Workset ByName](WorksetName=string_3)
elements_setworkset_2 = Custom[© Elements.SetWorkset](elements=all_elements_of_category_2, workset=workset_byname_2.Workset)  # frozen

# group: Filter by Parameter Value
# Beschreibung <Hier doppelklicken, um die Gruppenbeschreibung zu bearbeiten>
categories_3 = Categories("OST_Doors")
all_elements_of_category_3 = ElementsOfCategory(Category=categories_3)
string_4 = StringInput("NP_FilterParameterName")
ʳʰʸᵗʰᵐ_elements = Rhythm.Revit.Elements.Elements.GetParameterValueByNameTypeOrInstance(element=all_elements_of_category_3, parameterName=string_4)
string_from_object = FromObject(object=ʳʰʸᵗʰᵐ_elements)
string_5 = StringInput("Filter_Value")
eq_2 = string_from_object == string_5
filterByBoolMask_2 = List.FilterByBoolMask(list=ʳʰʸᵗʰᵐ_elements, mask=eq_2)
string_6 = StringInput("03 Türen")
workset_byname_3 = Custom[Workset ByName](WorksetName=string_6)
elements_setworkset_3 = Custom[© Elements.SetWorkset](elements=filterByBoolMask_2.in, workset=workset_byname_3.Workset)  # frozen

# group: Understand Workset Category
# Beschreibung <Hier doppelklicken, um die Gruppenbeschreibung zu bearbeiten>
categories_4 = Categories("OST_Doors")
all_elements_of_category_4 = ElementsOfCategory(Category=categories_4)
workset = Custom[Element.Workset](element=all_elements_of_category_4)  # package Clockwork for Dynamo 2.x; Retrieves the workset of a given element
kind = Custom[Workset.Kind](workset=workset)  # package Clockwork for Dynamo 2.x; Retrieves the kind of a given workset
uniqueItems = List.UniqueItems(list=kind)

# group: Find Visibility status for a specific workset for a certain view Type
# Beschreibung <Hier doppelklicken, um die Gruppenbeschreibung zu bearbeiten>
categories_5 = Categories("OST_Views")
all_elements_of_category_5 = ElementsOfCategory(Category=categories_5)
type = Custom[View.Type](view=all_elements_of_category_5)  # package Clockwork for Dynamo 2.x; Returns the type of a given view
string_from_object_2 = FromObject(object=type)
string_7 = StringInput("FloorPlan")
eq_3 = string_from_object_2 == string_7
filterByBoolMask_3 = List.FilterByBoolMask(list=all_elements_of_category_5, mask=eq_3)
string_8 = StringInput("03 Türen")
workset_byname_4 = Custom[Workset ByName](WorksetName=string_8)
ʳʰʸᵗʰᵐ_view_getworksetvisibility = Rhythm.Revit.Views.View.GetWorksetVisibility(view=filterByBoolMask_3.in, worksetId=workset_byname_4.Id)
code_block = CodeBlock(input=ʳʰʸᵗʰᵐ_view_getworksetvisibility)
# ---------- code_block.designscript (2 lines) ----------
input == "Use Global Setting (Visible)" ? "True":
input == "Show" ? "True": "False";
# ----------------------------------------

# group: Isolate all elements of the same workset in current view by category
# Beschreibung <Hier doppelklicken, um die Gruppenbeschreibung zu bearbeiten>
revit_currentview = Custom[© Revit.CurrentView]()  # package Crumple; Given the current document, return the active view.
string_9 = StringInput("03 Türen")
workset_byname_5 = Custom[Workset ByName](WorksetName=string_9)
byWorkset = archilab.Revit.Selection.Select.ByWorkset(workset=workset_byname_5.Workset)
worksets_isolateinview = Custom[© Worksets.IsolateInView](views=revit_currentview, worksets=byWorkset)  # package Crumple; Given a list of views and a list of worksets or workset names, attempts to isolate them all in those views.

# group: Isolate all elements of the same workset in multiple views by category
# Beschreibung <Hier doppelklicken, um die Gruppenbeschreibung zu bearbeiten>
view_types = Custom[View Types]()  # package Genius Loci; Enumerates the available view types.
code_block_2 = CodeBlock(input=view_types)
# ---------- code_block_2.designscript (27 lines) ----------
input == "AreaPlan" ? "Flächenplan" :
input == "CeilingPlan" ? "Deckenplan" :
input == "ColumnSchedule" ? "Säulenliste" :
input == "CostReport" ? "Kostenbericht" :
input == "Detail" ? "Detailansicht" :
input == "DraftingView" ? "Entwurfsansicht" :
input == "DrawingSheet" ? "Zeichnungsblatt" :
input == "Elevation" ? "Ansicht" :
input == "EngineeringPlan" ? "Tragwerksplan" :
input == "FloorPlan" ? "Grundriss" :
input == "Internal" ? "Intern" :
input == "Legend" ? "Legende" :
input == "LoadsReport" ? "Lastenbericht" :
input == "PanelSchedule" ? "Schalttafelliste" :
input == "PresureLossReport" ? "Druckverlustbericht" :
input == "ProjectBrowser" ? "Projektbrowser" :
input == "Rendering" ? "Rendering" :
input == "Report" ? "Bericht" :
input == "Schedule" ? "Bauteilliste" :
input == "Section" ? "Schnitt" :
input == "SystemBrowser" ? "Systembrowser" :
input == "SystemsAnalysisReport" ? "Systemanalysebericht" :
input == "ThreeD" ? "3D-Ansicht" :
input == "Undefined" ? "Nicht definiert" :
input == "View Template" ? "Ansichtsvorlage" :
input == "Walkthrough" ? "Kamerafahrt" :
input;
# ----------------------------------------
ansichttype_string = StringInput("Grundriss")  # graph input
eq_4 = code_block_2 == ansichttype_string
filterByBoolMask_4 = List.FilterByBoolMask(list=view_types, mask=eq_4)
getByType = archilab.Revit.Views.Views.GetByType(viewType=filterByBoolMask_4.in)
string_10 = StringInput("03 Türen")
workset_byname_6 = Custom[Workset ByName](WorksetName=string_10)
worksets_isolateinview_2 = Custom[© Worksets.IsolateInView](views=getByType@L2, worksets=workset_byname_6.Workset)
