# Dynamo graph NP_D_Plan_Erstellen_ExcelDatei(Planname-Plannummer-Ansichten).dyn (Dynamo 2.19.3.6394)
# packages: archi-lab.net 2025.300.1225, Clockwork for Dynamo 2.x 2.3.0

file_path = Filename("C:\Users\m.elsayed\OneDrive - Nickl-Architekten\Desktop\Scripts\Excel Sheets\Create sheets test.xlsx")  # graph input
file_from_path = FileObject(path=file_path)
exceldateitabellename_string = StringInput("Tabelle1")  # graph input
boolean = BoolSelector(true)
boolean_2 = BoolSelector(true)
importExcel = Data.ImportExcel(file=file_from_path, sheetName=exceldateitabellename_string, readAsStrings=boolean, showExcel=boolean_2)
transpose = List.Transpose(lists=importExcel)
code_block = CodeBlock(SheetName=transpose, SheetNumber=transpose, ViewNames=transpose) { SheetName[0]; SheetNumber[1]; ViewNames[2]; }
plankopf_familie_name_string = StringInput("1700x841")  # graph input
byName = FamilyType.ByName(name=plankopf_familie_name_string)
categories = Categories("OST_Views")
all_elements_of_category = ElementsOfCategory(Category=categories)
string = StringInput("Ansichtsname")
getParameterValueByName = Element.GetParameterValueByName(element=all_elements_of_category, parameterName=string)
python_script = Python(IN[0]=getParameterValueByName, IN[1]=code_block.out2)  # CPython3
# ---------- python_script.python (10 lines) ----------
A=IN[0]
B=IN[1]

S=[]
for a in A:
	if a in B:
		S.append(True)
	else:
		S.append(False)
OUT=S
# ----------------------------------------
filterByBoolMask = List.FilterByBoolMask(list=all_elements_of_category, mask=python_script)
name = Custom[Element.Name+](element=filterByBoolMask.in)  # package Clockwork for Dynamo 2.x; Gets an element's name. Unlike the OOTB node, this node should work for all Revit elements that have names and will also return the localized names of system parameters, parameter groups, display unit types, parameter types, unit symbol types and unit types.
length = String.Length(string=name)
ansichtnamesuffix_string = StringInput("_DUP")  # graph input
insert = String.Insert(string=name, index=length, toInsert=ansichtnamesuffix_string)
view_duplicate_options = ViewDuplicateOptions("WithDetailing")  # graph input
duplicate = archilab.Revit.Views.Views.Duplicate(view=filterByBoolMask.in, name=insert, options=view_duplicate_options)
byNameNumberTitleBlockAndView = Sheet.ByNameNumberTitleBlockAndView(sheetName=code_block.out0, sheetNumber=code_block.out1, titleBlockFamilyType=byName, view=duplicate)
