# Dynamo graph NP_D_Raumprogram_Umstrukturieren_Phase1.dyn "NP_D_Raumprogram_Umstrukturieren_Phase1(cleanup)" (Dynamo 2.19.3.6394)
# packages: BumbleBee 2021.25.2, Crumple 2024.4.3, Genius Loci 2024.5.29

# group: Fully Working (nulls included, Unclean numbers)
# Beschreibung <Hier doppelklicken, um die Gruppenbeschreibung zu bearbeiten>
file_path = Filename("..\..\..\Downloads\Testingg")
file_path_2 = Filename("..\..\..\Downloads\Bordeaux Renamed.xlsx")  # frozen
boolean = BoolSelector(true)
string = StringInput("CADRE SURFACES")
boolean_2 = BoolSelector(true)
read_excel = Custom[Read Excel](filePath=file_path_2, runIt=boolean, sheetName=string, byColumn=boolean_2)  # package BumbleBee; This node will read an excel file. You can read an entore sheet contents, read from specific origin cell, read only specific range, or do all of the former for multiple sheets at the same time.
code_block = CodeBlock(input=read_excel) { input[2]; input[3]; input[4]; input[5]; }
python_script = Python(IN[0]=code_block.out0)  # CPython3
# ---------- python_script.python (20 lines) ----------
# Load the Python Standard and DesignScript Libraries
import sys
import clr
clr.AddReference('ProtoGeometry')
from Autodesk.DesignScript.Geometry import *

# Inputs
data = IN[0]  # Your input list

# Forward fill logic
result = []
prev = None

for item in data:
    if item is not None:
        prev = item
    result.append(prev)

# Output
OUT = result
# ----------------------------------------
code_block_2 = CodeBlock(input=read_excel) { input[6]; input[15]; input[16]; }
watch = Watch(code_block_2.out1)
ofRepeatedItem = List.OfRepeatedItem(item=python_script@L1, amount=watch@L1)
flatten = List.Flatten(list=ofRepeatedItem)
python_script_2 = Python(IN[0]=code_block.out1)  # CPython3; same code as python_script
ofRepeatedItem_2 = List.OfRepeatedItem(item=python_script_2@L1, amount=watch@L1)
flatten_2 = List.Flatten(list=ofRepeatedItem_2)
python_script_3 = Python(IN[0]=code_block.out2)  # CPython3; same code as python_script
ofRepeatedItem_3 = List.OfRepeatedItem(item=python_script_3@L1, amount=watch@L1)
flatten_3 = List.Flatten(list=ofRepeatedItem_3)
python_script_4 = Python(IN[0]=code_block.out3)  # CPython3; same code as python_script
ofRepeatedItem_4 = List.OfRepeatedItem(item=python_script_4@L1, amount=watch@L1)
flatten_4 = List.Flatten(list=ofRepeatedItem_4)
watch_2 = Watch(code_block_2.out0)
string_from_object = FromObject(object=watch_2)
ofRepeatedItem_5 = List.OfRepeatedItem(item=string_from_object@L1, amount=watch@L1)
flatten_5 = List.Flatten(list=ofRepeatedItem_5)
number_slider = DoubleSlider(1, range=0..100 step 0.1)
number_slider_2 = DoubleSlider(0, range=0..100 step 0.1)
sequence = Sequence(start=number_slider, amount=watch@L1, step=number_slider_2)
flatten_6 = List.Flatten(list=sequence)
watch_3 = Watch(code_block_2.out2)
string_from_object_2 = FromObject(object=watch_3)
ofRepeatedItem_6 = List.OfRepeatedItem(item=string_from_object_2@L1, amount=watch@L1)
list_create = List.Create(item0=flatten, item1=flatten_2, item2=flatten_3, item3=flatten_4, item4=flatten_5, item5=flatten_6, item6=ofRepeatedItem_6)
transpose = List.Transpose(lists=list_create)
string_from_object_3 = FromObject(object=transpose)
string_2 = StringInput(";")
boolean_3 = BoolSelector(false)
csv_export = Custom[© CSV.Export](filepath=file_path, dataRows=string_from_object_3, delimiter=string_2, append=boolean_3)  # frozen; package Crumple; Given a matrix of strings, attempts to write them to a csv file (or make a new one if it doesn't exist.

# group: Fully Working (nulls removed, clean numbers)
# Beschreibung <Hier doppelklicken, um die Gruppenbeschreibung zu bearbeiten>
file_path_3 = Filename("..\..\..\Downloads\Testingg")
file_path_4 = Filename("..\..\..\Downloads\Bordeaux Renamed.xlsx")
boolean_4 = BoolSelector(true)
string_3 = StringInput("CADRE SURFACES")
boolean_5 = BoolSelector(true)
read_excel_2 = Custom[Read Excel](filePath=file_path_4, runIt=boolean_4, sheetName=string_3, byColumn=boolean_5)
code_block_3 = CodeBlock(input=read_excel_2) { input[2]; input[3]; input[4]; input[5]; }
python_script_5 = Python(IN[0]=code_block_3.out0)  # CPython3; same code as python_script
code_block_4 = CodeBlock(input=read_excel_2) { input[6]; input[15]; input[16]; }
watch_4 = Watch(code_block_4.out1)
ofRepeatedItem_7 = List.OfRepeatedItem(item=python_script_5@L1, amount=watch_4@L1)
flatten_7 = List.Flatten(list=ofRepeatedItem_7)
list_clean = Custom[List Clean](list=flatten_7)  # package Genius Loci; Removes all Null, Empty and Blank from a list or nested list of lists.
python_script_6 = Python(IN[0]=code_block_3.out1)  # CPython3; same code as python_script
ofRepeatedItem_8 = List.OfRepeatedItem(item=python_script_6@L1, amount=watch_4@L1)
flatten_8 = List.Flatten(list=ofRepeatedItem_8)
list_clean_2 = Custom[List Clean](list=flatten_8)
python_script_7 = Python(IN[0]=code_block_3.out2)  # CPython3; same code as python_script
ofRepeatedItem_9 = List.OfRepeatedItem(item=python_script_7@L1, amount=watch_4@L1)
flatten_9 = List.Flatten(list=ofRepeatedItem_9)
list_clean_3 = Custom[List Clean](list=flatten_9)
python_script_8 = Python(IN[0]=code_block_3.out3)  # CPython3; same code as python_script
ofRepeatedItem_10 = List.OfRepeatedItem(item=python_script_8@L1, amount=watch_4@L1)
flatten_10 = List.Flatten(list=ofRepeatedItem_10)
list_clean_4 = Custom[List Clean](list=flatten_10)
watch_5 = Watch(code_block_4.out0)
string_from_object_4 = FromObject(object=watch_5)
ofRepeatedItem_11 = List.OfRepeatedItem(item=string_from_object_4@L1, amount=watch_4@L1)
flatten_11 = List.Flatten(list=ofRepeatedItem_11)
list_clean_5 = Custom[List Clean](list=flatten_11)
number_slider_3 = DoubleSlider(1, range=0..100 step 0.1)
number_slider_4 = DoubleSlider(0, range=0..100 step 0.1)
sequence_2 = Sequence(start=number_slider_3, amount=watch_4@L1, step=number_slider_4)
flatten_12 = List.Flatten(list=sequence_2)
list_clean_6 = Custom[List Clean](list=flatten_12)
string_from_object_5 = FromObject(object=list_clean_6)
string_4 = StringInput(".")
split = String.Split(string=string_from_object_5, separator0=string_4)
firstItem = List.FirstItem(list=split@L2)
watch_6 = Watch(code_block_4.out2)
ofRepeatedItem_12 = List.OfRepeatedItem(item=watch_6@L1, amount=watch_4@L1)
flatten_13 = List.Flatten(list=ofRepeatedItem_12)
list_clean_7 = Custom[List Clean](list=flatten_13)
string_from_object_6 = FromObject(object=list_clean_7)
string_5 = StringInput(".")
split_2 = String.Split(string=string_from_object_6, separator0=string_5)
firstItem_2 = List.FirstItem(list=split_2@L2)
list_create_2 = List.Create(item0=list_clean, item1=list_clean_2, item2=list_clean_3, item3=list_clean_4, item4=list_clean_5, item5=firstItem, item6=firstItem_2)
transpose_2 = List.Transpose(lists=list_create_2)
string_6 = StringInput(";")
boolean_6 = BoolSelector(false)
csv_export_2 = Custom[© CSV.Export](filepath=file_path_3, dataRows=transpose_2, delimiter=string_6, append=boolean_6)
string_from_object_7 = FromObject(object=watch_6)
